# Grasshopper definition HeatLossGain.gh (Grasshopper 0.9.76)

# This example file is made 2017.09.20 20.56
panel = Panel("Calculating Heat Loss/Gain")
panel_2 = Panel("(W),(W/m2K),(m2),(K)")
panel_3 = Panel("Q = (U) (A) (∆T)")
panel_4 = Panel("Ventilation")
panel_5 = Panel("Infiltration")
panel_6 = Panel("Radiation")
panel_7 = Panel("Transmission")
expression = Expression(U=Slider(0.1, range=0.1..0.9), A=Slider(30, range=30..50), dT=Slider(32, range=0..35), Expression="U*A*dt")
panel_8 = Panel(expression)
